# Grasshopper definition example_00.gh (Grasshopper 1.0.7)
# plug-ins: Vespidae

pipeline = GeometryPipeline(
    GroupByLayer=False,
    GroupByType=False,
    IncludeHidden=True,
    IncludeLocked=True,
    LayerFilter="*",
    NameFilter="*",
    SublayerFiltering=True,
    TypeFilter=4)
sort_curves = SortCurveComponent(Curves=pipeline)
vespmove = MoveComponent(Curve=sort_curves, Speed=Slider(5000, range=0..10000), ToolId="t0")
number_slider = Slider(3, range=0..10)
panel = Panel(vespmove)
solve = SolveActionsComponent(
    Actions=vespmove,
    RetractHeight=Slider(41, range=0..100),
    TravelSpeed=Slider(7400, range=0..10000),
    PartialRetract=Toggle(True))
expose_paths = ExposePaths(Vespmo=solve, ArrowScl=Slider(2.8, range=0..10))  # -> AllMoves, AllTravel, Arrows
vespmogcode = Vespmo_Gcode_Component(VESPMO=solve)
panel_2 = Panel(solve)
panel_3 = Panel(vespmogcode)
